# Dynamo graph batchexport-pdf-dwg.dyn "video" (Dynamo 3.0.3.7597)
# packages: archi-lab.net 2021.25.2721, Crumple 2026.8.1

view_sets = ViewSetUi("Set 2")
viewsheetset_views = Custom[© ViewSheetSet.Views](viewSheetSet=view_sets)  # package Crumple; Return all views and sheets in the view sheet set(s).

# group: Parameters extraction
code_block = CodeBlock { "_"; }
file_path = Filename("C:\Users\piac9\Documents\Mywlca\Scripts\Batch exporter\List1.csv")
boolean = BoolSelector(false)
importCSV = Data.ImportCSV(filePath=file_path, transpose=boolean)
number = DoubleInput(1)
flatten = List.Flatten(list=importCSV, amount=number)
python_script = Python(IN[0]=viewsheetset_views, IN[1]=flatten)  # CPython3
# ---------- python_script.python (80 lines) ----------
import clr

# Revit API & Services
clr.AddReference("RevitServices")
from RevitServices.Persistence import DocumentManager
doc = DocumentManager.Instance.CurrentDBDocument

clr.AddReference("RevitAPI")
from Autodesk.Revit.DB import BuiltInParameter, StorageType

clr.AddReference("RevitNodes")
import Revit
clr.ImportExtensions(Revit.Elements)

# --- INPUT ---
input_elements = IN[0]

# Always unwrap
if isinstance(input_elements, list):
    elements = [UnwrapElement(el) for el in input_elements]
else:
    elements = [UnwrapElement(input_elements)]

paramRaw = IN[1]  # CSV list of parameter names

# Clean CSV strings
if not isinstance(paramRaw, list):
    paramRaw = [paramRaw]
paramNames = [str(x).strip().strip('"') for x in paramRaw]

# Built-in mapping
builtin_map = {
    "Sheet Number": BuiltInParameter.SHEET_NUMBER,
    "Sheet Name": BuiltInParameter.SHEET_NAME,
    "Designed By": BuiltInParameter.SHEET_DESIGNED_BY
}

results = []

for el in elements:
    row = []
    for name in paramNames:
        val = None

        # --- First try built-in ---
        if name in builtin_map:
            param = el.get_Parameter(builtin_map[name])
            if param:
                val = param.AsString()

        # --- Then try shared/project parameters ---
        if val is None:
            for p in el.Parameters:
                try:
                    if p.Definition.Name == name:
                        st = p.StorageType
                        if st == StorageType.String:
                            val = p.AsString()
                        elif st == StorageType.Double:
                            val = p.AsValueString() or str(p.AsDouble())
                        elif st == StorageType.Integer:
                            val = p.AsValueString() or str(p.AsInteger())
                        elif st == StorageType.ElementId:
                            idVal = p.AsElementId()
                            if idVal.IntegerValue >= 0:
                                elemRef = doc.GetElement(idVal)
                                val = elemRef.Name if elemRef else str(idVal.IntegerValue)
                            else:
                                val = ""
                        break
                except Exception as e:
                    val = "Error: " + str(e)

        if val is None:
            val = ""

        row.append(val)
    results.append(row)

OUT = results
# ----------------------------------------
join = String.Join(separator=code_block, string0=python_script)
number_2 = DoubleInput(1)
flatten_2 = List.Flatten(list=join, amount=number_2)
watch = Watch(flatten_2)

number_3 = DoubleInput(1)
flatten_3 = List.Flatten(list=importCSV, amount=number_3)
directory_path = Directory("C:\Users\piac9\Documents\Mywlca\Scripts\Batch exporter\video-export")  # graph input
revit_exportoptionsdwg = Custom[© Revit.ExportOptionsDwg]()  # package Crumple; Creates a DWG export options object, or retrieves one with the given name if found in the document.
export_dwgs = BoolSelector(true)  # graph input
revit_exporttodwg = Custom[© Revit.ExportToDwg](directoryPath=directory_path, viewsAndSheets=viewsheetset_views, fileNames=flatten_2, dwgExportOptions=revit_exportoptionsdwg.dwgExportOptions, runMe=export_dwgs)  # package Crumple; Given a list of views and/or sheets as well as various related settings, attempts to export them to DWG using the provided settings.
watch_2 = Watch(revit_exporttodwg.filePaths)
revit_exporttopdf = Custom[© Revit.ExportToPdf](directoryPath=directory_path, sheets=viewsheetset_views, fileNames=flatten_2)  # package Crumple; Given a list of sheets, names, directory and export options this node will batch export PDF files. Requires Revit 2022 or higher to work.
watch_3 = Watch(revit_exporttopdf.success)
watch_4 = Watch(revit_exporttodwg.success)  # graph output
